# Grasshopper definition archi_cartogram.gh (Grasshopper 1.0.7)
# plug-ins: Human, Kangaroo2 Components

reset_to_1_0 = Button()

# ----
# MAIN DRIVING SLIDER
panel = Panel("main")
guide_val = Slider(1, range=0..1)

panel_2 = Panel("set target multipliers")
m1 = Slider(0.5, range=0.1..4)
m2 = Slider(1, range=0.1..4)
m3 = Slider(1.5, range=0.1..4)
m4 = Slider(2, range=0.1..4)
m5 = Slider(2.1, range=0.1..4)
m6 = Slider(2.2, range=0.1..4)
m7 = Slider(2.3, range=0.1..4)
R = Reset(Sliders="guide_val", Values="0", update=reset_to_1_0)  # inputs Sliders: list, Values: list
# ---------- R: Python ----------
""" Reset named sliders """
if update:
    import Grasshopper as gh
    
    # Get to the GH objects
    ghObjects = ghenv.Component.OnPingDocument().Objects
    
    # Iterate the GH objects
    for obj in ghObjects:
        
        print(obj.NickName)
        
        # Set the named slider values
        if obj.NickName in Sliders:
            if type(obj) is gh.Kernel.Special.GH_NumberSlider:
                
                # Set min/max
                obj.Slider.Minimum = 0
                obj.Slider.Maximum = 1
                
                # Set value
                obj.Slider.Value = Values[Sliders.index(obj.NickName)]
                
                # Update slider
                obj.ExpireSolution(True)
# ---------- end R ----------
entwine = Entwine(Branch00=m1, Branch01=m2, Branch02=m5, Branch03=m3, Branch04=m4, Branch05=m6, Branch06=m7, FlattenInputs=True)  # -> flatten(Result)
python = GhPythonScript(guide_val=guide_val, tar_multipliers=entwine)  # -> out, out_multipliers; inputs tar_multipliers: list
# ---------- python: Python ----------
import ghpythonlib.treehelpers as th

def remap(s, a1, a2, b1, b2):
    t = b1 + ((s - a1)*(b2 - b1))/(a2 - a1)
    return t

out_multipliers = [remap(guide_val, 0, 1, 1, tar_m) for tar_m in tar_multipliers]

#out_multipliers_ = th.list_to_tree(out_multipliers)
print(out_multipliers)
# ---------- end python ----------
panel_3 = Panel(python.out_multipliers)
# set group layer name to import sub-layer geometry and sub-layer names
# 
# Hit 'RESET!' button to reflect changes made in Rhino (for example when adding new geometry to certain layers or changing layer names, moving geo from one layer to another etc.)
group_layer_name = Panel("ZONES_only")
show_elements = BooleanToggle(False)
test_close_poly = BooleanToggle(False)
show_skeleton = BooleanToggle(False)
show_verts = BooleanToggle(False)
show_rods = BooleanToggle(False)
reset = Button()
layersfromgrouplayer = GhPythonScript(groupLay=group_layer_name, RESET=reset)  # -> out, lNames, all_lNames
# ---------- layersfromgrouplayer: Python ----------
ghenv.Component.NickName = "LayersFromGroupLayer"

if not RESET:   
    import rhinoscriptsyntax as rs
    import scriptcontext as sc
    import Rhino
    
    sc.doc = Rhino.RhinoDoc.ActiveDoc
    all_lNames = rs.LayerNames()
    
    # filter by group name
    lNames = [n for n in all_lNames if groupLay in n if "::" in n]
    
    
    
    print(lNames)

#lNames = lNames[39:]
# ---------- end layersfromgrouplayer ----------

# ----
# m1, m2 etc. are placeholder material names. When updating make sure that layer names in Rhino model match slider names  in Grasshopper
# Material EE Multipliers
# in 'Entwine' node always remove any unused input node
# MAIN CONTROL SLIDERS
reset_to_1_0_2 = Button()
m1_2 = Slider(1, range=0.5..4)
m3_2 = Slider(1, range=0.5..4)
m4_2 = Slider(1, range=0.5..4)
m5_2 = Slider(1.6, range=0.5..4)
m6_2 = Slider(1, range=0.5..4)
m2_2 = Slider(1, range=0.5..4)
m8 = Slider(1, range=0.5..5)
entwine_2 = Entwine(Branch00=m1_2, Branch01=m2_2, Branch02=m3_2, Branch04=m5_2, FlattenInputs=True)

# ----
# Turn to False when resetting multipliers
# Kangaroo SIM
runsim = BooleanToggle(False)

# ----
# Turn to False when resetting multipliers.
# 
# When 'Capture Active' is True, any change in the grasshopper file (eg multiplier slider changes) will trigger screenshot capture
# Screenshot controls
capture_active = BooleanToggle(False)
capture_one_frame = Button()  # disabled
output_folder = Panel("191028_zones_v8_zonesonly")
viewport_name = Panel("000")
resolution_x = Panel("1920")
resolution_y = Panel("1080")
res_multiplier = Panel("1")

clear_folder = Button()
m9 = Slider(1, range=0.5..5)
m10 = Slider(1, range=0.5..5)
m11 = Slider(1, range=0.5..5)
panel_4 = Panel(layersfromgrouplayer.lNames)
not = GateNot(A=capture_active)
# connect "multiplier_" node or the "entwine" node depending on whether the sim is controlled by one main slider ("multipliers_") or by manually shifting each single multiplier slider ("entwine")
multipliers = Data(python.out_multipliers)
python_2 = GhPythonScript(layNames=layersfromgrouplayer.all_lNames, active=Toggle(True), hide=not)  # -> out; inputs layNames: list
# ---------- python_2: Python ----------
__author__ = "Lorenzo"
__version__ = "2019.10.28"

import rhinoscriptsyntax as rs

def lay_visibility(lay_names, HIDE):
    current_lay = "current_temp"
    rs.AddLayer("current_temp")
    rs.CurrentLayer(current_lay)
    for ln in lay_names:
        if ln != current_lay:
            print(ln, HIDE)
            rs.LayerVisible(ln, HIDE)



if active and not _hide:
    lay_visibility(layNames, _hide)
# ---------- end python_2 ----------
panel_5 = Panel(python_2)
flatten = FlattenTree(Tree=multipliers, Path="{0}")
geofromlayers = GhPythonScript(cleanLayName=Toggle(True), input_names=panel_4, deformation_mult=flatten)  # -> out, layCols, layNames, m1_1984, m2_2006_gal, m5_2019_of, m3_2006_of, m4_2019_gal, m6_2019_sh, m7_2019_entr; inputs input_names: list, deformation_mult: list
# ---------- geofromlayers: Python ----------
__author__ = "Lorenzo"
__version__ = "2019.09.30"

import rhinoscriptsyntax as rs
import scriptcontext as sc
import Rhino


sc.doc = Rhino.RhinoDoc.ActiveDoc

ghenv.Component.NickName = "GeoFromLayers"

def get_layCols(input_names_lst):
    cols = [rs.LayerColor(lay_n) for lay_n in input_names_lst]
    return cols

def deform_area(polyline_geo, mult_val):
    polyline_geo = rs.coerceguid(polyline_geo)
    polyline_area = rs.CurveArea(polyline_geo)[0]
    return polyline_area * mult_val

def set_input_names(input_names_lst):
    i = 0

    for i, in_name in enumerate(input_names_lst):
    	ghenv.Component.Params.Input[i].NickName = in_name

def set_output_names(output_names_lst):
    out_ = "out"
    lay_cols = "layCols"
    lay_names = "layNames"
    
    if cleanLayName:
        output_names_lst = cleanLayerName(output_names_lst)
    
    output_names_lst = [lay_cols] + [lay_names] + output_names_lst 
    output_names_lst = [out_] + output_names_lst
    
    
    i = 0
#    print(i)
    for i, name in enumerate(output_names_lst):
    	ghenv.Component.Params.Output[i].NickName = name

def set_global_vars(input_names_dict):
    for k in input_names_dict:
        sc.sticky[k] = input_names_dict[k]

def out_geo(input_names_lst=[], temps_lst=[]):
    if cleanLayName:
        cleanLayNames = cleanLayerName(input_names_lst)
    
    for i, n in enumerate(input_names_lst):
#        print(i,n)
        geo = rs.ObjectsByLayer(n)
        
        mult = deformation_mult[i]
#        deformed_area = deform_area(geo, mult)
        print("mult: {}, layGeo: {}".format(mult, cleanLayNames[i]))
        
        globals()[cleanLayNames[i]] = geo
        globals()[cleanLayNames[i]] = [mult] + globals()[cleanLayNames[i]]

def layNames_out(input_names_lst):
    globals()["layNames"] = cleanLayerName(input_names_lst)

def layCols_out(input_names_lst):
    cols = get_layCols(input_names_lst)
    globals()["layCols"] = cols

def cleanLayerName(layNames_lst):
    clean_layNames = []
    
    for i, n in enumerate(layNames_lst):
        for j, nameChar in enumerate(n):
#            print(j, nameChar)
            if nameChar == ":":
                clean_layNames.append(n[j+2:])
                break

         
    return clean_layNames              



set_output_names(input_names)
layNames_out(input_names)
layCols_out(input_names)
out_geo(input_names_lst=input_names)
# ---------- end geofromlayers ----------

lng = ListLength(List=geofromlayers.m1_1984)
dup = DuplicateData(Data="1", Number=lng, Order=True)
R_2 = Reset(Sliders=geofromlayers.m1_1984, Values=dup, update=reset_to_1_0_2)  # inputs Sliders: list, Values: list
# ---------- R_2: Python ----------
""" Reset named sliders """
if update:
    import Grasshopper as gh
    
    # Get to the GH objects
    ghObjects = ghenv.Component.OnPingDocument().Objects
    
    # Iterate the GH objects
    for obj in ghObjects:
        
        print(obj.NickName)
        
        # Set the named slider values
        if obj.NickName in Sliders:
            if type(obj) is gh.Kernel.Special.GH_NumberSlider:
                
                # Set min/max
                obj.Slider.Minimum = 0.5
                obj.Slider.Maximum = 4
                
                # Set value
                obj.Slider.Value = Values[Sliders.index(obj.NickName)]
                
                # Update slider
                obj.ExpireSolution(True)
# ---------- end R_2 ----------

ma = MassAddition(Input=flatten)  # -> Result, PartialResults
entwine_3 = Entwine(
    Branch00=geofromlayers.m1_1984,
    Branch01=geofromlayers.m2_2006_gal,
    Branch02=geofromlayers.m5_2019_of,
    Branch03=geofromlayers.m3_2006_of,
    Branch04=geofromlayers.m4_2019_gal,
    Branch05=geofromlayers.m6_2019_sh,
    Branch06=geofromlayers.m7_2019_entr,
    FlattenInputs=True)
out = Out(data=entwine_3)  # -> mult_2, polygon_data_2
pipeline = GeometryPipeline(
    GroupByLayer=False,
    GroupByType=False,
    IncludeHidden=True,
    IncludeLocked=True,
    LayerFilter="geo_ctrl::rods_",
    NameFilter="*",
    SublayerFiltering=True,
    TypeFilter=4)
mult = Data(out.mult_2)
polygon_data = Data(out.polygon_data_2)
polygon_data_2 = Data(polygon_data)
lng_2 = ListLength(List=polygon_data_2)
test_close_polys = TestClosePolys(active=test_close_poly, polygon_data=polygon_data)
area = Area(Geometry=polygon_data)  # -> Area, Centroid
lng_3 = ListLength(List=flatten(lng_2))
end = EndPoints(Curve=pipeline)  # -> Start, End
multiplication = Multiplication(A=mult, B=area.Area)
area_2 = Area(Geometry=polygon_data_2)  # -> Area, Centroid
boundary = BoundarySurfaces(Edges=polygon_data_2)
series = Series(Start=0, Step=1, Count=lng_3)
gradient = Gradient(
    LowerLimit=0,
    UpperLimit=lng_3,
    Parameter=series,
    stops=[0: RGB(243, 57, 0), 0.1: RGB(236, 27, 60), 0.2: RGB(210, 0, 118), 0.3: RGB(103, 0, 120), 0.4: RGB(39, 72, 161), 0.5: RGB(1, 192, 229), 0.6: RGB(18, 178, 90), 0.7: RGB(79, 186, 8), 0.8: RGB(220, 237, 32), 0.9: RGB(247, 159, 20), 1: RGB(243, 57, 0)])
neg = Negative(Value=Slider(0.989, range=0..1))
pt = Point([end.Start, end.End])
lng_4 = ListLength(List=multiplication)  # -> flatten(Length)
swatch = ColourSwatch(SwatchColor=RGB(115, 115, 115))
target_polygon_area = Data(multiplication)
Y = UnitY(Factor=neg)
polygon_data_3 = Data(polygon_data)
crv = Curve(polygon_data_3)
crv_2 = Curve(flatten(crv))
area_3 = Area(Geometry=crv_2)  # -> Area, Centroid
points = PointList(Points=area_3.Centroid, Size=Slider(1, range=0..10))
move = Move(Geometry=area_2.Centroid, Motion=Y)  # -> Geometry, Transform
material_ref = Data(geofromlayers.m1_1984)
python_3 = GhPythonScript(ACTIVE=show_elements, in=boundary)  # -> out, out_2; inputs in: list; same code as python
panel_6 = Panel(target_polygon_area)
lng_5 = ListLength(List=target_polygon_area)
lng_6 = ListLength(List=polygon_data_3)
col = Colour(geofromlayers.layCols)
lng_7 = ListLength(List=flatten(lng_5))
lng_8 = ListLength(List=flatten(lng_6))

preview = CustomPreview(Geometry=python_3.out_2, Material=graft(col))
# Preview to check material mapping
tag = TextTag(Location=move.Geometry, Text=graft(material_ref), Colour=swatch)

panel_7 = Panel(lng_7)
panel_8 = Panel(lng_8)
panel_9 = Panel(polygon_data_3)
branch = TreeBranch(Tree=simplify(polygon_data), Path="{5}", MaintainPaths=True)
branch_2 = TreeBranch(Tree=simplify(polygon_data), Path="{3}", MaintainPaths=True)

# ----
# ROD BEHAVIOR CONSTRAINT
crv_3 = Curve(pipeline)
number_slider = Slider(1.957, range=0..5)
python_4 = GhPythonScript(ACTIVE=show_rods, in=crv_3)  # -> out, out_2; inputs in: list; same code as python
rod = Rod(Polyline=flatten(crv_3), LengthFactor=1, AngleFactor=1, AxialStrength=number_slider, BendStrength=number_slider)
previewlw = CustomPreviewLineweights(Geometry=python_4.out_2, Shader=ColourSwatch(SwatchColor=RGB(255, 0, 0)), Thickness="8", Absolute=False)

# ----
# POLYGON EDGES LENGTH CONSTRAINT
number_slider_2 = Slider(0.75, range=0..1)
explode = Explode(Curve=branch_2, Recursive=True)  # -> flatten(Segments), Vertices
len = Length(Curve=explode.Segments)
multiplication_2 = Multiplication(A=len, B=number_slider_2)
multiplication_3 = Multiplication(A=len, B=Slider(3, range=0..10))
clamplength = ClampLength(Line=explode.Segments, LowerLimit=multiplication_2, UpperLimit=multiplication_3, Strength=Slider(2, range=0..10))

# ----
# POLYGON EDGES LENGTH CONSTRAINT
number_slider_3 = Slider(0.35, range=0..1)
explode_2 = Explode(Curve=branch, Recursive=True)  # -> flatten(Segments), Vertices
len_2 = Length(Curve=explode_2.Segments)
multiplication_4 = Multiplication(A=len_2, B=number_slider_3)
multiplication_5 = Multiplication(A=len_2, B=Slider(2, range=0..10))
clamplength_2 = ClampLength(Line=explode_2.Segments, LowerLimit=multiplication_4, UpperLimit=multiplication_5, Strength=1)

crv_4 = Curve(<curve referenced from the Rhino model>)

# ----
# ANCHORS CONSTRAINT
pipeline_2 = GeometryPipeline(
    GroupByLayer=False,
    GroupByType=False,
    IncludeHidden=True,
    IncludeLocked=True,
    LayerFilter="geo_ctrl::anchors_",
    NameFilter="*",
    SublayerFiltering=True,
    TypeFilter=1)
anchor = Anchor(Point=pipeline_2, Strength=10000)
dots = DotDisplay(Point=pipeline_2, Colour="red", Size="1")

# ----
# ANGLE CONSTRAINT
explode_3 = Explode(Curve=crv_2, Recursive=True)  # -> Segments, Vertices
shift = ShiftList(List=explode_3.Segments, Shift=1, Wrap=True)
angle = Angle(LineA=explode_3.Segments, LineB=shift, Strength=1)

swatch_2 = ColourSwatch(SwatchColor=RGB(255, 255, 255))
Z = UnitZ(Factor=1)

# ----
# Local directory
python_5 = GhPythonScript()  # -> out, fd
# ---------- python_5: Python ----------
__author__ = "Lorenzo"
__version__ = "2019.04.05"

import rhinoscriptsyntax as rs
import os

# get file path of current gh file
fp = ghenv.LocalScope.ghdoc.Path
print("current gh file path: {}".format(fp))

# get file directory and file name
(fd, fn) = os.path.split(fp)
print("file directory: {}".format(fd))
print("file name: {}".format(fn))
print("----")
# ---------- end python_5 ----------

neg_2 = Negative(Value=Slider(2104, range=400..2104))
Y_2 = UnitY(Factor=neg_2)
material_ref_2 = Data(geofromlayers.layNames)

panel_10 = Panel(output_folder)
python_6 = GhPythonScript(output_dir_name="frames", branch_name=panel_10, model_dir=python_5.fd)  # -> out, out_dir
# ---------- python_6: Python ----------
__author__ = "Lorenzo"
__version__ = "2019.03.23"

import rhinoscriptsyntax as rs
import os

out_dir = os.path.join(
    model_dir,
    output_dir_name,
    branch_name)

if not os.path.exists(out_dir):
    os.makedirs(out_dir)
# ---------- end python_6 ----------
panel_11 = Panel(python_6.out_dir)
resy = Number(resolution_y)
resx = Number(resolution_x)

vp_name = Data(viewport_name)
python_7 = GhPythonScript(val=ma.Result)  # -> out, n
# ---------- python_7: Python ----------
import time

seconds = int(time.time() * 100)
val *= 1000
val = int(val)

n = "{}_{}".format(seconds, val)
# ---------- end python_7 ----------
concat = Concatenate(FragmentA="sol_", FragmentB=python_7.n)
panel_12 = Panel(mult)
gradient_2 = Gradient(
    LowerLimit="0.2",
    UpperLimit="2",
    Parameter=mult,
    stops=[0.15: RGB(255, 247, 0), 0.481: RGB(255, 132, 0), 0.85: RGB(220, 0, 40)])
panel_13 = Panel(gradient_2)

python_8 = GhPythonScript(active_restore_view=Toggle(False), active_zoom_bbox=Toggle(False), vp_name=vp_name)  # -> out, a; inputs bbox_pts: list of Point3d
# ---------- python_8: Python ----------
__author__ = "Lorenzo"
__version__ = "2019.03.26"

import rhinoscriptsyntax as rs
import Rhino
import scriptcontext as sc
sc.doc = Rhino.RhinoDoc.ActiveDoc

def zoom_bbox(pts, vpName):
    pts = rs.coerce3dpointlist(pts)
    if pts:
        bbox = Rhino.Geometry.BoundingBox(pts)
        RhinoDocument = Rhino.RhinoDoc.ActiveDoc
        view = RhinoDocument.Views.Find(vpName, False)
        vp = view.ActiveViewport
        vp.ZoomBoundingBox(bbox)
        print('zoom extent on curve boundingbox')
    else:
        print('no pts geo provided for zoom bbox')   

def set_view(vpName):
    rs.RestoreNamedView(vpName)
    print("{} view restored".format(vpName))

if vp_name:
    if active_restore_view:
        set_view(vp_name)
else:
    print("no view name provided")

if bbox_pts:
    if active_zoom_bbox:
        zoom_bbox(bbox_pts, vp_name)
else:
    print("no pts provided")        
    
a = bbox_pts
# ---------- end python_8 ----------
panel_14 = Panel(python_8.out)

item = ListItem(List=python_8.out, Index=0, Wrap=True)

# ---- group: view cap
python_9 = GhPythonScript(
    x=item,
    create_dir=Button(),
    clear_imgs_dir=clear_folder,
    active=capture_active,
    r5=Toggle(False),
    dir=python_6.out_dir,
    img_name=concat,
    vp_name=vp_name,
    w_px=resx,
    h_px=resy,
    res_multiplier=res_multiplier)  # -> out, active_out
# ---------- python_9: Python ----------
__author__ = "Lorenzo"
__version__ = "2019.03.23"

import rhinoscriptsyntax as rs
import Rhino
import System.Drawing
import os
import scriptcontext as sc
import shutil
import time

#imgs_dir = os.path.join(dir, 'imgs')
imgs_dir = dir
if create_dir:
    if not os.path.exists(imgs_dir):
        os.makedirs(imgs_dir)

def remove_folder_contents(dir):
    for the_file in os.listdir(dir):
        file_path = os.path.join(dir, the_file)
        try:
            if os.path.isfile(file_path):
                os.unlink(file_path)
        except Exception as e:
			print("error: {}".format(e))

if clear_imgs_dir:
    remove_folder_contents(imgs_dir)

#vp_name = "000"
#w_px = 1100
#h_px = 1100
scale_f = res_multiplier
fext = '.png'

def check_and_fix_for_duplicates(file_path):
    duplicate = True
    print('duplicate')
    counter = 1
    while duplicate:
        duplicate = os.path.exists(file_path)
        if not duplicate:
            break
        if duplicate:
            fn = file_path.split("\\")[-1]
            path_elements = file_path.split("\\")[:-1]
            print(fn[-3])
            if fn[-8] == "_":
                new_fn = fn[:-8] + "_" + "{:03d}".format(counter) + ".png"
                counter += 1
                path_elements.append(new_fn)
                file_path = "\\".join(path_elements)
    
            else:
                new_fn = fn[:-5] + "_" + "{:03d}".format(counter) + ".png"
                counter += 1
                path_elements.append(new_fn)
                file_path = "\\".join(path_elements)
    return file_path           

if img_name == None:
    img_name = "give_me_a_name"
fn = str(img_name) + fext
fp = os.path.join(imgs_dir, fn)
#if os.path.exists(fp): 
#    fn = str(img_name) + "_02" + fext
#    fp = os.path.join(imgs_dir, fn)
fp = check_and_fix_for_duplicates(fp)


def vcap_to_file(viewportName='Top', width=w_px, height=h_px, scale_factor=1, file_path=''):
    print("working")
    RhinoDocument = Rhino.RhinoDoc.ActiveDoc
    view = RhinoDocument.Views.Find(viewportName, False)
    print(view)

    # view settings
    if view:
        
        view.Floating = True
        view.Size = System.Drawing.Size(width, height)
        
        view_capture = Rhino.Display.ViewCapture()
#        print(view_capture)
        view_capture.Width = view.ActiveViewport.Size.Width * scale_factor
        view_capture.Height = view.ActiveViewport.Size.Height * scale_factor
        view_capture.ScaleScreenItems = False
        view_capture.DrawAxes = False
        view_capture.DrawGrid = False
        view_capture.DrawGridAxes = False
        view_capture.TransparentBackground = False
        bitmap = view_capture.CaptureToBitmap(view)
        
        if bitmap:
            bitmap.Save(file_path, System.Drawing.Imaging.ImageFormat.Png)
            print("saved {}".format(fp))

def vcap_to_file_r5(viewportName='Top', width=w_px, height=h_px, scale_factor=1, file_path=''):
    view_capture_cmd = "_-ViewCaptureToFile \"" +  \
            file_path + \
            "\" Width " + str(width*scale_factor) + \
            " Height " + str(height*scale_factor) + \
            " Enter "
    rs.Command(view_capture_cmd)
    print("saved (r5) {}".format(fp))



if active:
#    time.sleep(1)
    
    if r5:
        vcap_to_file_r5(viewportName = vp_name, 
                        width = w_px,
                        height = h_px,
                        scale_factor = scale_f,
                        file_path = fp)
        
    else:                   
        vcap_to_file(viewportName = vp_name, 
                    width = w_px,
                    height = h_px,
                    scale_factor = scale_f,
                    file_path = fp)
    if img_name:
        active_out = True
else:
    print("not active")
    active_out = False
# ---------- end python_9 ----------
panel_15 = Panel(python_9.out)

# ----
pipeline_3 = GeometryPipeline(
    GroupByLayer=False,
    GroupByType=False,
    IncludeHidden=True,
    IncludeLocked=True,
    LayerFilter="geo_ctrl::add_verts_",
    NameFilter="*",
    SublayerFiltering=True,
    TypeFilter=1)
# ADD VERTICES OF ADJACENT POLYGONS
explode_4 = Explode(Curve=crv_2, Recursive=True)  # -> Segments, Vertices

# ----
# LINE WORK W/ELASTIC LENGTH PRESERVATION
pipeline_4 = GeometryPipeline(
    GroupByLayer=False,
    GroupByType=False,
    IncludeHidden=True,
    IncludeLocked=True,
    LayerFilter="LINEWORK*",
    NameFilter="*",
    SublayerFiltering=True,
    TypeFilter=4)  # disabled

explode_5 = Explode(Curve=pipeline_4, Recursive=True)  # -> flatten(Segments), Vertices
dupln = RemoveDuplicateLines(Lines=explode_5.Segments, Tolerance=0.01)

crv_5 = Curve(dupln)

explode_6 = Explode(Curve=crv_5, Recursive=True)  # -> Segments, Vertices
crv_cp = CurveClosestPoint(Point=flatten(explode_6.Vertices), Curve=graft(crv_5))  # -> Point, Parameter, Distance
smaller = SmallerThan(FirstNumber=crv_cp.Distance, SecondNumber="0.0001")  # -> SmallerThan, OrEqualTo
dispatch = Dispatch(List=crv_cp.Parameter, DispatchPattern=smaller.OrEqualTo)  # -> ListA, ListB
shatter = Shatter(Curve=graft(crv_5), Parameters=dispatch.ListA)
join = JoinCurves(Curves=shatter, Preserve=False)  # -> flatten(Curves)
crv_6 = Curve(join)

crv_cp_2 = CurveClosestPoint(Point=flatten([explode_4.Vertices, pt, pipeline_3, explode_6.Vertices]), Curve=graft(crv_2))  # -> Point, Parameter, Distance
smaller_2 = SmallerThan(FirstNumber=crv_cp_2.Distance, SecondNumber="0.0001")  # -> SmallerThan, OrEqualTo
dispatch_2 = Dispatch(List=crv_cp_2.Parameter, DispatchPattern=smaller_2.OrEqualTo)  # -> ListA, ListB
shatter_2 = Shatter(Curve=graft(crv_2), Parameters=dispatch_2.ListA)
join_2 = JoinCurves(Curves=shatter_2, Preserve=False)  # -> flatten(Curves)

# ----
# CREATE POLYGON SKELETON
crv_7 = Curve(join_2)

crv_8 = Curve(join_2)
diag = Diagonalize(Mesh=crv_8)
tri = Triangulate(Mesh=crv_8)  # -> Mesh, Count
medges = MeshEdges(Mesh=diag)  # -> NakedEdges, InteriorEdges, NonManifoldEdges
crv_9 = Curve(flatten([medges.NakedEdges, medges.InteriorEdges]))
python_10 = GhPythonScript(ACTIVE=show_skeleton, in=crv_9)  # -> out, out_2; inputs in: list; same code as python
previewlw_2 = CustomPreviewLineweights(
    Geometry=python_10.out_2,
    Shader=ColourSwatch(SwatchColor=RGB(196, 196, 196)),
    Thickness=Slider(2, range=0..10),
    Absolute=False)

area_4 = Area(Geometry=crv_7)  # -> Area, graft(Centroid)
explode_7 = Explode(Curve=crv_7, Recursive=True)  # -> Segments, Vertices
ln = Line(StartPoint=explode_7.Vertices, EndPoint=area_4.Centroid)
crv_10 = Curve(join_2)
explode_8 = Explode(Curve=crv_10, Recursive=True)  # -> Segments, Vertices
area_5 = Area(Geometry=crv_10)  # -> Area, Centroid
python_11 = GhPythonScript(ACTIVE=show_verts, in=explode_8.Vertices)  # -> out, out_2; inputs in: list; same code as python
dot = DotDisplay(Point=python_11.out_2)
tag_2 = TextTag(Location=area_5.Centroid, Text=area_5.Area)

# ----
# POLYLINE AREA TARGET CONSTRAINT
target_areas = Data(flatten(target_polygon_area))
polylines = Data(crv_10)
polygonarea = PolygonArea(Polyline=polylines, Area=target_areas, Strength=1)

show = Show(G=crv_10)

# ----
# SKELETON CONSTRAINT
number_slider_4 = Slider(3, range=0..10)
len_3 = Length(Curve=crv_9)
multiplication_6 = Multiplication(A=len_3, B=number_slider_4)
clamplength_3 = ClampLength(Line=crv_9, LowerLimit=len_3, UpperLimit=multiplication_6, Strength=1)

# ----
# ROD BEHAVIOR CONSTRAINT
number_slider_5 = Slider(1.957, range=0..5)
rod_2 = Rod(Polyline=flatten(crv_10), LengthFactor=1, AngleFactor=1, AxialStrength=number_slider_5, BendStrength=number_slider_5)

# ----
# POLYGON EDGES LENGTH CONSTRAINT
number_slider_6 = Slider(0.35, range=0..1)
explode_9 = Explode(Curve=join_2, Recursive=True)  # -> flatten(Segments), Vertices
len_4 = Length(Curve=explode_9.Segments)
multiplication_7 = Multiplication(A=len_4, B=number_slider_6)
multiplication_8 = Multiplication(A=len_4, B=Slider(2, range=0..10))
clamplength_4 = ClampLength(Line=explode_9.Segments, LowerLimit=multiplication_7, UpperLimit=multiplication_8, Strength=1)

pl = PlasticLength(Line=crv_6, Limit=1, Strength=Slider(3, range=0..3))  # disabled
show_2 = Show(G=crv_6)  # disabled

kangaroo_goals = Data([polygonarea, show, anchor, clamplength_3, angle, rod])
bool = Boolean(runsim)
stepsolver = StepSolver(
    GoalObjects=flatten(kangaroo_goals),
    Tolerance=0.01,
    Momentum=False,
    Damping=0.99,
    SubIterations=Slider(20, range=0..20),
    Animate=bool)  # -> I, V, O

panel_16 = Panel(kangaroo_goals)
crv_11 = Curve(stepsolver.O)
clean = CleanTree(RemoveNulls=True, RemoveInvalid=True, RemoveEmpty=False, Tree=crv_11)
clean_2 = CleanTree(RemoveNulls=True, RemoveInvalid=True, RemoveEmpty=False, Tree=crv_11)
python_12 = GhPythonScript(geo=clean_2)  # -> out, out_2, lines_out; inputs geo: list of Curve
# ---------- python_12: Python ----------
import rhinoscriptsyntax as rs

out_ = []
lines_out_ = []
for g in geo:
    t = str(type(g))
    geo_type = t.split()[1]
    
    if geo_type != "'LineCurve'>":
        print("it's not a line")
        out_.append(g)
    else:
        lines_out_.append(g)
# ---------- end python_12 ----------
crv_12 = Curve(python_12.lines_out)
partition = PartitionList(List=python_12.out_2, Size=lng_4)
move_2 = Move(Geometry=python_12.out_2, Motion=Z)  # -> Geometry, Transform
area_6 = Area(Geometry=partition)  # -> Area, Centroid
previewlw_3 = CustomPreviewLineweights(Geometry=move_2.Geometry, Shader=swatch_2, Thickness=Slider(2, range=0..10), Absolute=False)
tag_3 = TextTag(Location=area_6.Centroid, Text=mult, Colour=swatch_2)
area_7 = Area(Geometry=partition)  # -> Area, Centroid
move_3 = Move(Geometry=area_7.Centroid, Motion=Y_2)  # -> Geometry, Transform
boundary_2 = BoundarySurfaces(Edges=partition)
tag_4 = TextTag(Location=move_3.Geometry, Text=graft(material_ref_2), Colour=swatch)
area_8 = Area(Geometry=boundary_2)  # -> flatten(Area), Centroid
bnd = Bounds(Numbers=area_8.Area)
dedomain = DeconstructDomain(Domain=bnd)  # -> Start, End
preview_2 = CustomPreview(Geometry=boundary_2, Material=gradient_2)

# ==== cluster Out
data = ClusterInput()
data_2 = Data(data)
item = ListItem(List=data_2, Index=0, Wrap=True)
cull_i = CullIndex(List=data_2, Indices=0, Wrap=True)
polygon_data = Data(cull_i)
mult = Data(item)
mult_2 = ClusterOutput(mult)
polygon_data_2 = ClusterOutput(polygon_data)

# ==== cluster TestClosePolys
polygon_data = ClusterInput()
active = ClusterInput()
polygon_data_2 = Data(polygon_data)
python = GhPythonScript(ACTIVE=active, in=polygon_data_2)  # -> out, out_2; inputs in: list
# ---------- python: Python ----------
out_ = None
if ACTIVE:
    out_ = _in
# ---------- end python ----------
cls = Closed(Curve=python.out_2)  # -> Closed, Periodic
python_2 = GhPythonScript(close_tests=cls.Closed)  # -> out, lws, cols; inputs close_tests: list
# ---------- python_2: Python ----------
cols = ["blue" if close_test else "red" 
            for close_test in close_tests]
lws = [5 if close_test else 12 
            for close_test in close_tests]
# ---------- end python_2 ----------
panel = Panel(python_2.cols)
previewlw = CustomPreviewLineweights(Geometry=python.out_2, Shader=python_2.cols, Thickness=python_2.lws, Absolute=False)
