# Grasshopper definition test_archi_cartogram.gh (Grasshopper 1.0.7)
# plug-ins: Human, LunchBox, Kangaroo2 Components

pipeline = GeometryPipeline(
    GroupByLayer=False,
    GroupByType=False,
    IncludeHidden=True,
    IncludeLocked=True,
    LayerFilter="persp_polys",
    NameFilter="*",
    SublayerFiltering=True,
    TypeFilter=4)  # disabled
number_slider = Slider(0.175, range=0..1)  # disabled
crv = Curve(pipeline)  # disabled
number_slider_2 = Slider(0.175, range=0..1)  # disabled
randomsplit = RandomSplitList(MasterList=crv, Seed=2, Split=number_slider)  # -> ListA, ListB; disabled
crv_2 = Curve(randomsplit.ListB)  # disabled
crv_3 = Curve(randomsplit.ListA)  # disabled
number_slider_3 = Slider(0.175, range=0..1)  # disabled
randomsplit_2 = RandomSplitList(MasterList=crv_3, Seed=2, Split=number_slider_2)  # -> ListA, ListB; disabled
crv_4 = Curve(randomsplit_2.ListB)  # disabled
crv_5 = Curve(randomsplit_2.ListA)  # disabled
number_slider_4 = Slider(0.175, range=0..1)  # disabled
randomsplit_3 = RandomSplitList(MasterList=crv_5, Seed=2, Split=number_slider_3)  # -> ListA, ListB; disabled
crv_6 = Curve(randomsplit_3.ListB)  # disabled
crv_7 = Curve(randomsplit_3.ListA)  # disabled
number_slider_5 = Slider(0.175, range=0..1)  # disabled
randomsplit_4 = RandomSplitList(MasterList=crv_7, Seed=2, Split=number_slider_4)  # -> ListA, ListB; disabled
crv_8 = Curve(randomsplit_4.ListB)  # disabled
crv_9 = Curve(randomsplit_4.ListA)  # disabled
randomsplit_5 = RandomSplitList(MasterList=crv_9, Seed=2, Split=number_slider_5)  # -> ListA, ListB; disabled
crv_10 = Curve(randomsplit_5.ListB)  # disabled
crv_11 = Curve(randomsplit_5.ListA)  # disabled
layersfromgrouplayer = GhPythonScript(groupLay="MATERIALS_persp", RESET=Button())  # -> out, lNames
# ---------- layersfromgrouplayer: Python ----------
ghenv.Component.NickName = "LayersFromGroupLayer"

if not RESET:   
    import rhinoscriptsyntax as rs
    import scriptcontext as sc
    import Rhino
    
    sc.doc = Rhino.RhinoDoc.ActiveDoc
    lNames = rs.LayerNames()
    
    # filter by group name
    lNames = [n for n in lNames if groupLay in n if "::" in n]
    
    
    
    print(lNames)

#lNames = lNames[39:]
# ---------- end layersfromgrouplayer ----------
capture = BooleanToggle(False)
# deformation multipliers per material
m1 = Slider(1, range=0.5..5)
m2 = Slider(1, range=0.5..5)
m3 = Slider(1, range=0.5..5)
m4 = Slider(1, range=0.5..5)
m5 = Slider(1, range=0.5..5)
m6 = Slider(1, range=0.5..5)
m7 = Slider(1, range=0.5..5)
reset_to_1_0 = Button()
runsim = BooleanToggle(False)
pipeline_2 = GeometryPipeline(
    GroupByLayer=False,
    GroupByType=False,
    IncludeHidden=True,
    IncludeLocked=True,
    LayerFilter="Layer 04",
    NameFilter="*",
    SublayerFiltering=True,
    TypeFilter=1)
panel = Panel(layersfromgrouplayer.lNames)
entwine = Entwine(Branch00=m1, Branch01=m2, Branch02=m3, Branch03=m4, Branch04=m5, Branch05=m6, FlattenInputs=True)
flatten = FlattenTree(Tree=entwine, Path="{0}")
oct = OcTree(Points=pipeline_2, Square=False, Group=5)  # -> Boxes, Points
pipeline_3 = GeometryPipeline(
    GroupByLayer=False,
    GroupByType=False,
    IncludeHidden=True,
    IncludeLocked=True,
    LayerFilter="in_",
    NameFilter="*",
    SublayerFiltering=True,
    TypeFilter=4)
pipeline_4 = GeometryPipeline(
    GroupByLayer=False,
    GroupByType=False,
    IncludeHidden=True,
    IncludeLocked=True,
    LayerFilter="in2_",
    NameFilter="*",
    SublayerFiltering=True,
    TypeFilter=4)
geofromlayers = GhPythonScript(cleanLayName=Toggle(True), input_names=panel, deformation_mult=flatten)  # -> out, layNames, m1, m2, m3, m4, m5, m6, m7; inputs input_names: list, deformation_mult: list
# ---------- geofromlayers: Python ----------
__author__ = "Lorenzo"
__version__ = "2019.09.30"

import rhinoscriptsyntax as rs
import scriptcontext as sc
import Rhino


sc.doc = Rhino.RhinoDoc.ActiveDoc

ghenv.Component.NickName = "GeoFromLayers"

def deform_area(polyline_geo, mult_val):
    polyline_geo = rs.coerceguid(polyline_geo)
    polyline_area = rs.CurveArea(polyline_geo)[0]
    return polyline_area * mult_val

def set_input_names(input_names_lst):
    i = 0

    for i, in_name in enumerate(input_names_lst):
    	ghenv.Component.Params.Input[i].NickName = in_name

def set_output_names(output_names_lst):
    out_ = "out"
    lay_names = "layNames"
    
    if cleanLayName:
        output_names_lst = cleanLayerName(output_names_lst)
    
    output_names_lst = [lay_names] + output_names_lst
    output_names_lst = [out_] + output_names_lst
    
    
    i = 0
#    print(i)
    for i, name in enumerate(output_names_lst):
    	ghenv.Component.Params.Output[i].NickName = name

def set_global_vars(input_names_dict):
    for k in input_names_dict:
        sc.sticky[k] = input_names_dict[k]

def out_geo(input_names_lst=[], temps_lst=[]):
    if cleanLayName:
        cleanLayNames = cleanLayerName(input_names_lst)
    
    for i, n in enumerate(input_names_lst):
#        print(i,n)
        geo = rs.ObjectsByLayer(n)
        
        mult = deformation_mult[i]
#        deformed_area = deform_area(geo, mult)
        print("mult: {}, layGeo: {}".format(mult, cleanLayNames[i]))
        
        globals()[cleanLayNames[i]] = geo
        globals()[cleanLayNames[i]] = [mult] + globals()[cleanLayNames[i]]

def layNames_out(input_names_lst):
    globals()["layNames"] = cleanLayerName(input_names_lst)

def cleanLayerName(layNames_lst):
    clean_layNames = []
    
    for i, n in enumerate(layNames_lst):
        for j, nameChar in enumerate(n):
#            print(j, nameChar)
            if nameChar == ":":
                clean_layNames.append(n[j+2:])
                break

         
    return clean_layNames              



set_output_names(input_names)
layNames_out(input_names)
out_geo(input_names_lst=input_names)
# ---------- end geofromlayers ----------
debrep = DeconstructBrep(Brep=oct.Boxes)  # -> Faces, Edges, Vertices

lng = ListLength(List=geofromlayers.layNames)
dup = DuplicateData(Data="1", Number=lng, Order=True)
R = Reset(Sliders=geofromlayers.layNames, Values=dup, update=reset_to_1_0)  # inputs Sliders: list, Values: list
# ---------- R: Python ----------
""" Reset named sliders """
if update:
    import Grasshopper as gh
    
    # Get to the GH objects
    ghObjects = ghenv.Component.OnPingDocument().Objects
    
    # Iterate the GH objects
    for obj in ghObjects:
        
        print(obj.NickName)
        
        # Set the named slider values
        if obj.NickName in Sliders:
            if type(obj) is gh.Kernel.Special.GH_NumberSlider:
                
                # Set min/max
                obj.Slider.Minimum = 0.5
                obj.Slider.Maximum = 5
                
                # Set value
                obj.Slider.Value = Values[Sliders.index(obj.NickName)]
                
                # Update slider
                obj.ExpireSolution(True)
# ---------- end R ----------

ma = MassAddition(Input=flatten)  # -> Result, PartialResults
join = JoinCurves(Curves=debrep.Edges, Preserve=False)  # -> flatten(Curves)
entwine_2 = Entwine(
    Branch00=geofromlayers.m1,
    Branch01=geofromlayers.m2,
    Branch02=geofromlayers.m3,
    Branch03=geofromlayers.m4,
    Branch04=geofromlayers.m5,
    Branch05=geofromlayers.m6,
    FlattenInputs=True)
out = Out(data=entwine_2)  # -> mult_2, polygon_data_2
area = Area(Geometry=out.polygon_data_2)  # -> flatten(Area), Centroid
mult = Data(out.mult_2)
polygon_data = Data(out.polygon_data_2)
polygon_data_2 = Data(polygon_data)
lng_2 = ListLength(List=polygon_data_2)
area_2 = Area(Geometry=polygon_data)  # -> Area, Centroid
lng_3 = ListLength(List=flatten(lng_2))
multiplication = Multiplication(A=mult, B=area_2.Area)
area_3 = Area(Geometry=polygon_data_2)  # -> Area, Centroid
boundary = BoundarySurfaces(Edges=polygon_data_2)
series = Series(Start=0, Step=1, Count=lng_3)
gradient = Gradient(
    LowerLimit=0,
    UpperLimit=lng_3,
    Parameter=series,
    stops=[0: RGB(243, 57, 0), 0.1: RGB(236, 27, 60), 0.2: RGB(210, 0, 118), 0.3: RGB(103, 0, 120), 0.4: RGB(39, 72, 161), 0.5: RGB(1, 192, 229), 0.6: RGB(18, 178, 90), 0.7: RGB(79, 186, 8), 0.8: RGB(220, 237, 32), 0.9: RGB(247, 159, 20), 1: RGB(243, 57, 0)])
neg = Negative(Value=Slider(0.989, range=0..1))
lng_4 = ListLength(List=multiplication)  # -> flatten(Length)
swatch = ColourSwatch(SwatchColor=RGB(115, 115, 115))
target_polygon_area = Data(multiplication)
polygon_data_3 = Data(polygon_data)
crv_12 = Curve(polygon_data_3)
crv_13 = Curve(flatten(crv_12))

# ----
# ADD VERTICES OF ADJACENT POLYGONS
explode = Explode(Curve=crv_13, Recursive=True)  # -> Segments, Vertices
crv_cp = CurveClosestPoint(Point=flatten(explode.Vertices), Curve=graft(crv_13))  # -> Point, Parameter, Distance
smaller = SmallerThan(FirstNumber=crv_cp.Distance, SecondNumber="0.0001")  # -> SmallerThan, OrEqualTo
dispatch = Dispatch(List=crv_cp.Parameter, DispatchPattern=smaller.OrEqualTo)  # -> ListA, ListB
shatter = Shatter(Curve=graft(crv_13), Parameters=dispatch.ListA)
join_2 = JoinCurves(Curves=shatter, Preserve=False)  # -> flatten(Curves)

Y = UnitY(Factor=neg)
move = Move(Geometry=area_3.Centroid, Motion=Y)  # -> Geometry, Transform
material_ref = Data(geofromlayers.layNames)
area_4 = Area(Geometry=crv_13)  # -> Area, Centroid
preview = CustomPreview(Geometry=boundary, Material=graft(gradient))
tag = TextTag(Location=move.Geometry, Text=graft(material_ref), Colour=swatch)
points = PointList(Points=area_4.Centroid, Size=Slider(1, range=0..10))

# ----
# CREATE POLYGON SKELETON
crv_14 = Curve(join_2)
diag = Diagonalize(Mesh=crv_14)
tri = Triangulate(Mesh=crv_14)  # -> Mesh, Count
medges = MeshEdges(Mesh=diag)  # -> NakedEdges, InteriorEdges, NonManifoldEdges
crv_15 = Curve(flatten(medges.InteriorEdges))
previewlw = CustomPreviewLineweights(Geometry=crv_15, Shader=ColourSwatch(SwatchColor=RGB(196, 196, 196)), Thickness=Slider(0, range=0..10), Absolute=False)

crv_16 = Curve(join_2)
area_5 = Area(Geometry=crv_16)  # -> Area, Centroid
branch = TreeBranch(Tree=simplify(polygon_data), Path="{3}", MaintainPaths=True)
tag_2 = TextTag(Location=area_5.Centroid, Text=area_5.Area)
target_areas = Data(flatten(target_polygon_area))
# POLYGON EDGES LENGTH CONSTRAINT
explode_2 = Explode(Curve=branch, Recursive=True)  # -> flatten(Segments), Vertices
polylines = Data(crv_16)
len = Length(Curve=explode_2.Segments)
# POLYGON EDGES LENGTH CONSTRAINT
explode_3 = Explode(Curve=branch, Recursive=True)  # -> flatten(Segments), Vertices
multiplication_2 = Multiplication(A=len, B=Slider(0.35, range=0..1))
multiplication_3 = Multiplication(A=len, B=Slider(2, range=0..10))
len_2 = Length(Curve=explode_3.Segments)
# ROD BEHAVIOR CONSTRAINT
number_slider_6 = Slider(1.957, range=0..5)
# POLYGON EDGES LENGTH CONSTRAINT
explode_4 = Explode(Curve=join_2, Recursive=True)  # -> flatten(Segments), Vertices
# ANGLE CONSTRAINT
explode_5 = Explode(Curve=crv_13, Recursive=True)  # -> Segments, Vertices
# ANCHORS CONSTRAINT
pipeline_5 = GeometryPipeline(
    GroupByLayer=False,
    GroupByType=False,
    IncludeHidden=True,
    IncludeLocked=True,
    LayerFilter="anchors_",
    NameFilter="*",
    SublayerFiltering=True,
    TypeFilter=1)
# SKELETON CONSTRAINT
len_3 = Length(Curve=crv_15)
multiplication_4 = Multiplication(A=len_2, B=Slider(0.75, range=0..1))
multiplication_5 = Multiplication(A=len_2, B=Slider(3, range=0..10))
len_4 = Length(Curve=explode_4.Segments)
clamplength = ClampLength(Line=explode_2.Segments, LowerLimit=multiplication_2, UpperLimit=multiplication_3, Strength=1)
shift = ShiftList(List=explode_5.Segments, Shift=1, Wrap=True)
show = Show(G=crv_16)
multiplication_6 = Multiplication(A=len_3, B=Slider(3, range=0..10))
polygonarea = PolygonArea(Polyline=polylines, Area=target_areas, Strength=1)
multiplication_7 = Multiplication(A=len_4, B=Slider(0.35, range=0..1))
multiplication_8 = Multiplication(A=len_4, B=Slider(2, range=0..10))
clamplength_2 = ClampLength(Line=explode_3.Segments, LowerLimit=multiplication_4, UpperLimit=multiplication_5, Strength=Slider(2, range=0..10))
rod = Rod(Polyline=flatten(crv_16), LengthFactor=1, AngleFactor=1, AxialStrength=number_slider_6, BendStrength=number_slider_6)
clamplength_3 = ClampLength(Line=crv_15, LowerLimit=len_3, UpperLimit=multiplication_6, Strength=1)
clamplength_4 = ClampLength(Line=explode_4.Segments, LowerLimit=multiplication_7, UpperLimit=multiplication_8, Strength=1)
angle = Angle(LineA=explode_5.Segments, LineB=shift, Strength=1)
anchor = Anchor(Point=pipeline_5, Strength=10000)
dots = DotDisplay(Point=pipeline_5, Colour="red", Size="1")
kangaroo_goals = Data([polygonarea, show, anchor, clamplength_3, angle, clamplength_2, clamplength])
bool = Boolean(runsim)
stepsolver = StepSolver(
    GoalObjects=flatten(kangaroo_goals),
    Tolerance=0.01,
    Momentum=False,
    Damping=0.99,
    SubIterations=Slider(20, range=0..20),
    Animate=bool)  # -> I, V, O
swatch_2 = ColourSwatch(SwatchColor=RGB(5, 0, 0))
crv_17 = Curve(stepsolver.O)
clean = CleanTree(RemoveNulls=True, RemoveInvalid=True, RemoveEmpty=False, Tree=crv_17)
previewlw_2 = CustomPreviewLineweights(Geometry=crv_17, Shader=swatch_2, Thickness=Slider(2, range=0..10), Absolute=False)
clean_2 = CleanTree(RemoveNulls=True, RemoveInvalid=True, RemoveEmpty=False, Tree=crv_17)
panel_2 = Panel(mult)
partition = PartitionList(List=clean_2, Size=lng_4)
area_6 = Area(Geometry=partition)  # -> Area, Centroid
boundary_2 = BoundarySurfaces(Edges=partition)
area_7 = Area(Geometry=boundary_2)  # -> flatten(Area), Centroid
bnd = Bounds(Numbers=area_7.Area)
tag_3 = TextTag(Location=area_6.Centroid, Text=mult, Colour=swatch_2)
dedomain = DeconstructDomain(Domain=bnd)  # -> Start, End
branch_2 = TreeBranch(Tree=simplify(boundary_2), Path="{3}", MaintainPaths=True)
gradient_2 = Gradient(
    LowerLimit="0.2",
    UpperLimit="2",
    Parameter=mult,
    stops=[0.15: RGB(255, 247, 0), 0.481: RGB(255, 132, 0), 0.85: RGB(220, 0, 40)])

# ----
# Local directory
python = GhPythonScript()  # -> out, fd
# ---------- python: Python ----------
__author__ = "Lorenzo"
__version__ = "2019.04.05"

import rhinoscriptsyntax as rs
import os

# get file path of current gh file
fp = ghenv.LocalScope.ghdoc.Path
print("current gh file path: {}".format(fp))

# get file directory and file name
(fd, fn) = os.path.split(fp)
print("file directory: {}".format(fd))
print("file name: {}".format(fn))
print("----")
# ---------- end python ----------

neg_2 = Negative(Value=Slider(0.989, range=0..1))
panel_3 = Panel(gradient_2)
area_8 = Area(Geometry=partition)  # -> Area, Centroid
Y_2 = UnitY(Factor=neg_2)
move_2 = Move(Geometry=area_8.Centroid, Motion=Y_2)  # -> Geometry, Transform
preview_2 = CustomPreview(Geometry=boundary_2, Material=gradient_2)
material_ref_2 = Data(geofromlayers.layNames)
number_slider_7 = Slider(0.398, range=0..1)
tag_4 = TextTag(Location=move_2.Geometry, Text=graft(material_ref_2), Colour=swatch)

# ---- group: site
geo = Geometry()

# ----
python_2 = GhPythonScript(val=ma.Result)  # -> out, n
# ---------- python_2: Python ----------
import time

seconds = int(time.time() * 100)
val *= 1000
val = int(val)

n = "{}_{}".format(seconds, val)
# ---------- end python_2 ----------
data = Data()
txt = Text(data)
python_3 = GhPythonScript(y=txt)  # -> out, a; inputs y: list
# ---------- python_3: Python ----------
__author__ = "Lorenzo"
__version__ = "2019.05.16"

import rhinoscriptsyntax as rs
import time

sep = '_'

a = sep.join(y)
# ---------- end python_3 ----------
concat = Concatenate(FragmentA="sol_", FragmentB=python_2.n)

panel_4 = Panel("elev_demo_03")
python_4 = GhPythonScript(output_dir_name="gh_out", branch_name=panel_4, model_dir=python.fd)  # -> out, out_dir
# ---------- python_4: Python ----------
__author__ = "Lorenzo"
__version__ = "2019.03.23"

import rhinoscriptsyntax as rs
import os

out_dir = os.path.join(
    model_dir,
    branch_name)

if not os.path.exists(out_dir):
    os.makedirs(out_dir)
# ---------- end python_4 ----------
panel_5 = Panel(python_4.out_dir)
num = Number("1760")
num_2 = Number("1100")

python_5 = GhPythonScript(vpname="000")  # -> out, cam_plane
# ---------- python_5: Python ----------
__author__ = "Lorenzo"
__version__ = "2019.05.08"

import rhinoscriptsyntax as rs

def get_cam_plane(vpName):
    
    view_cam = rs.CurrentView(vpName)
    
    if view_cam:
        cam_plane = rs.ViewCameraPlane(view_cam)
        return cam_plane

cam_plane = get_cam_plane(vpname)
# ---------- end python_5 ----------
bbox = BoundingBox(Content=flatten(geo), Plane=python_5.cam_plane, UnionBox=True)  # -> Box, Box_2
volume = Volume(Geometry=bbox.Box)  # -> Volume, Centroid
scale = Scale(Geometry=bbox.Box, Center=volume.Centroid, Factor=Slider(0.373, range=0..1))  # -> Geometry, Transform
debrep_2 = DeconstructBrep(Brep=scale.Geometry)  # -> Faces, flatten(Edges), Vertices

crv_18 = Curve(debrep_2.Edges)
explode_6 = Explode(Curve=crv_18, Recursive=True)  # -> Segments, flatten(Vertices)

python_6 = GhPythonScript(active_restore_view=Toggle(False), active_zoom_bbox=Toggle(False), bbox_pts=explode_6.Vertices, vp_name="000")  # -> out, a; inputs bbox_pts: list of Point3d
# ---------- python_6: Python ----------
__author__ = "Lorenzo"
__version__ = "2019.03.26"

import rhinoscriptsyntax as rs
import Rhino
import scriptcontext as sc
sc.doc = Rhino.RhinoDoc.ActiveDoc

def zoom_bbox(pts, vpName):
    pts = rs.coerce3dpointlist(pts)
    if pts:
        bbox = Rhino.Geometry.BoundingBox(pts)
        RhinoDocument = Rhino.RhinoDoc.ActiveDoc
        view = RhinoDocument.Views.Find(vpName, False)
        vp = view.ActiveViewport
        vp.ZoomBoundingBox(bbox)
        print('zoom extent on curve boundingbox')
    else:
        print('no pts geo provided for zoom bbox')   

def set_view(vpName):
    rs.RestoreNamedView(vpName)
    print("{} view restored".format(vpName))

if vp_name:
    if active_restore_view:
        set_view(vp_name)
else:
    print("no view name provided")

if bbox_pts:
    if active_zoom_bbox:
        zoom_bbox(bbox_pts, vp_name)
else:
    print("no pts provided")        
    
a = bbox_pts
# ---------- end python_6 ----------
panel_6 = Panel(python_6.out)

item = ListItem(List=python_6.out, Index=0, Wrap=True)

# ---- group: view cap
python_7 = GhPythonScript(
    x=item,
    create_dir=Button(),
    clear_imgs_dir=Button(),
    active=capture,
    r5=Toggle(False),
    dir=python_4.out_dir,
    img_name=concat,
    vp_name="000",
    w_px=num_2,
    h_px=num)  # -> out, active_out
# ---------- python_7: Python ----------
__author__ = "Lorenzo"
__version__ = "2019.03.23"

import rhinoscriptsyntax as rs
import Rhino
import System.Drawing
import os
import scriptcontext as sc
import shutil
import time

#imgs_dir = os.path.join(dir, 'imgs')
imgs_dir = dir
if create_dir:
    if not os.path.exists(imgs_dir):
        os.makedirs(imgs_dir)

def remove_folder_contents(dir):
    for the_file in os.listdir(dir):
        file_path = os.path.join(dir, the_file)
        try:
            if os.path.isfile(file_path):
                os.unlink(file_path)
        except Exception as e:
			print("error: {}".format(e))

if clear_imgs_dir:
    remove_folder_contents(imgs_dir)

#vp_name = "000"
#w_px = 1100
#h_px = 1100
scale_f = 2
fext = '.png'

def check_and_fix_for_duplicates(file_path):
    duplicate = True
    print('duplicate')
    counter = 1
    while duplicate:
        duplicate = os.path.exists(file_path)
        if not duplicate:
            break
        if duplicate:
            fn = file_path.split("\\")[-1]
            path_elements = file_path.split("\\")[:-1]
            print(fn[-3])
            if fn[-8] == "_":
                new_fn = fn[:-8] + "_" + "{:03d}".format(counter) + ".png"
                counter += 1
                path_elements.append(new_fn)
                file_path = "\\".join(path_elements)
    
            else:
                new_fn = fn[:-5] + "_" + "{:03d}".format(counter) + ".png"
                counter += 1
                path_elements.append(new_fn)
                file_path = "\\".join(path_elements)
    return file_path           

if img_name == None:
    img_name = "give_me_a_name"
fn = str(img_name) + fext
fp = os.path.join(imgs_dir, fn)
#if os.path.exists(fp): 
#    fn = str(img_name) + "_02" + fext
#    fp = os.path.join(imgs_dir, fn)
fp = check_and_fix_for_duplicates(fp)


def vcap_to_file(viewportName='Top', width=w_px, height=h_px, scale_factor=1, file_path=''):
    print("working")
    RhinoDocument = Rhino.RhinoDoc.ActiveDoc
    view = RhinoDocument.Views.Find(viewportName, False)
    print(view)

    # view settings
    if view:
        
        view.Floating = True
        view.Size = System.Drawing.Size(width, height)
        
        view_capture = Rhino.Display.ViewCapture()
#        print(view_capture)
        view_capture.Width = view.ActiveViewport.Size.Width * scale_factor
        view_capture.Height = view.ActiveViewport.Size.Height * scale_factor
        view_capture.ScaleScreenItems = False
        view_capture.DrawAxes = False
        view_capture.DrawGrid = False
        view_capture.DrawGridAxes = False
        view_capture.TransparentBackground = False
        bitmap = view_capture.CaptureToBitmap(view)
        
        if bitmap:
            bitmap.Save(file_path, System.Drawing.Imaging.ImageFormat.Png)
            print("saved {}".format(fp))

def vcap_to_file_r5(viewportName='Top', width=w_px, height=h_px, scale_factor=1, file_path=''):
    view_capture_cmd = "_-ViewCaptureToFile \"" +  \
            file_path + \
            "\" Width " + str(width*scale_factor) + \
            " Height " + str(height*scale_factor) + \
            " Enter "
    rs.Command(view_capture_cmd)
    print("saved (r5) {}".format(fp))



if active:
#    time.sleep(1)
    
    if r5:
        vcap_to_file_r5(viewportName = vp_name, 
                        width = w_px,
                        height = h_px,
                        scale_factor = scale_f,
                        file_path = fp)
        
    else:                   
        vcap_to_file(viewportName = vp_name, 
                    width = w_px,
                    height = h_px,
                    scale_factor = scale_f,
                    file_path = fp)
    if img_name:
        active_out = True
else:
    print("not active")
    active_out = False
# ---------- end python_7 ----------
panel_7 = Panel(python_7.out)

# ----
item_2 = ListItem(List=python_7.out, Index=0, Wrap=True)

# ==== cluster Out
data = ClusterInput()
data_2 = Data(data)
item = ListItem(List=data_2, Index=0, Wrap=True)
cull_i = CullIndex(List=data_2, Indices=0, Wrap=True)
polygon_data = Data(cull_i)
mult = Data(item)
mult_2 = ClusterOutput(mult)
polygon_data_2 = ClusterOutput(polygon_data)
